# Grasshopper definition blindspreview.gh (Grasshopper 1.0.8)

number_slider = Slider(1000, range=0..1000)
panel = Panel("""0.0, 0.0, 0.0
1000.0, 0.0, 0.0
0.0, 0.0, 250.0
1000.0, 0.0, 250.0
0.0, 0.0, 500.0
1000.0, 0.0, 500.0
0.0, 0.0, 750.0
1000.0, 0.0, 750.0
0.0, 0.0, 1000.0
1000.0, 0.0, 1000.0""")
xz = XZPlane(Origin=Point(0, 0, 0))
rectangle = Rectangle(Plane=xz, XSize=number_slider, YSize=number_slider, Radius=0)  # -> Rectangle, Length
pt = Point(panel)
panel_2 = Panel("""0.0, -81.6, 0.0
1000.0, -81.6, 0.0
0.0, -220.8, 250.0
1000.0, -220.8, 250.0
0.0, -68.9, 500.0
1000.0, -68.9, 500.0
0.0, -112.4, 750.0
1000.0, -112.4, 750.0
0.0, -230.8, 1000.0
1000.0, -230.8, 1000.0""")
dispatch = Dispatch(List=pt, DispatchPattern=[True, False])  # -> ListA, ListB
c_script = CSharpScript(fileName="blinds_extruded.csv", folderName="results")  # -> filePath; inputs fileName: String, folderName: String
# ---------- c_script: C# ----------
// Grasshopper Script Instance
#region Usings
using System;
using System.IO;
using System.Linq;
using System.Collections;
using System.Collections.Generic;
using System.Drawing;

using Rhino;
using Rhino.Geometry;

using Grasshopper;
using Grasshopper.Kernel;
using Grasshopper.Kernel.Data;
using Grasshopper.Kernel.Types;
#endregion

public class Script_Instance : GH_ScriptInstance
{
    #region Notes
    /* 
      Members:
        RhinoDoc RhinoDocument
        GH_Document GrasshopperDocument
        IGH_Component Component
        int Iteration

      Methods (Virtual & overridable):
        Print(string text)
        Print(string format, params object[] args)
        Reflect(object obj)
        Reflect(object obj, string method_name)
    */
    #endregion

    private void RunScript(string fileName, string folderName, ref object filePath)
    {
        // 输入参数：folderName（可为空）、fileName（必须）、输出参数：fullPath
        string fullPath = "";

        // 获取 gh 文件路径
        string ghPath = Grasshopper.Instances.DocumentServer[0].FilePath;

        if (string.IsNullOrEmpty(ghPath))
        {
            Print("请先保存 Grasshopper 文件。");
        }
        else
        {
            // gh 文件所在目录（如 CrvGrowth/gh）
            string ghDir = System.IO.Path.GetDirectoryName(ghPath);

            // 工程根目录（即 CrvGrowth）
            string projectRoot = System.IO.Path.GetFullPath(Path.Combine(ghDir, ".."));

            // 判断是否指定了文件夹
            if (string.IsNullOrWhiteSpace(folderName))
            {
                // 没有指定文件夹，直接从根目录拼接文件名
                fullPath = Path.Combine(projectRoot, fileName);
            }
            else
            {
                // 指定了文件夹，从根目录 + 文件夹名 + 文件名拼接
                fullPath = Path.Combine(projectRoot, folderName, fileName);
            }

            // 标准化路径
            filePath = Path.GetFullPath(fullPath);
        }
    }
}
# ---------- end c_script ----------
c_script_2 = CSharpScript(fileName="blinds_vertical.csv", folderName="results")  # -> filePath; inputs fileName: String, folderName: String; same code as c_script
ln = Line(StartPoint=dispatch.ListA, EndPoint=dispatch.ListB)
file = ReadFile(File=c_script, PerLineParse=True)
file_2 = ReadFile(File=c_script_2, PerLineParse=True)
pdecon = Deconstruct(Point=file)  # -> XComponent, YComponent, ZComponent
pdecon_2 = Deconstruct(Point=file_2)  # -> XComponent, YComponent, ZComponent
pt_2 = Point(panel_2)
vec = VectorXYZ(XComponent=pdecon.XComponent, YComponent=pdecon.YComponent, ZComponent=pdecon.ZComponent)  # -> Vector, Length
vec_2 = VectorXYZ(XComponent=pdecon_2.XComponent, YComponent=pdecon_2.YComponent, ZComponent=pdecon_2.ZComponent)  # -> Vector, Length
panel_3 = Panel("""0.0, -73.9, 34.6
1000.0, -73.9, 34.6
0.0, -23.5, 469.5
1000.0, -23.5, 469.5
0.0, -41.1, 555.3
1000.0, -41.1, 555.3
0.0, -64.4, 657.9
1000.0, -64.4, 657.9
0.0, -43.6, 1226.7
1000.0, -43.6, 1226.7""")
dispatch_2 = Dispatch(List=pt_2, DispatchPattern=[True, False])  # -> ListA, ListB
pt_3 = Point(vec_2.Vector)
pt_4 = Point(vec.Vector)
ln_2 = Line(StartPoint=dispatch_2.ListA, EndPoint=dispatch_2.ListB)
dispatch_3 = Dispatch(List=pt_3, DispatchPattern=[True, False])  # -> ListA, ListB
dispatch_4 = Dispatch(List=pt_4, DispatchPattern=[True, False])  # -> ListA, ListB
ln_3 = Line(StartPoint=dispatch_3.ListA, EndPoint=dispatch_3.ListB)
ln_4 = Line(StartPoint=dispatch_4.ListA, EndPoint=dispatch_4.ListB)
pt_5 = Point(panel_3)
dispatch_5 = Dispatch(List=pt_5, DispatchPattern=[True, False])  # -> ListA, ListB
ln_5 = Line(StartPoint=dispatch_5.ListA, EndPoint=dispatch_5.ListB)
rulesrf = RuledSurface(CurveA=ln_5, CurveB=ln)
rulesrf_2 = RuledSurface(CurveA=ln_3, CurveB=ln_4)
c_script_3 = CSharpScript(fileName="blinds_lighting_winter.csv", folderName="results")  # -> filePath; inputs fileName: String, folderName: String; same code as c_script
c_script_4 = CSharpScript(fileName="blinds_lighting_summer.csv", folderName="results")  # -> filePath; inputs fileName: String, folderName: String; same code as c_script
file_3 = ReadFile(File=c_script_3, PerLineParse=True)  # -> simplify(Content)
dispatch_6 = Dispatch(List=file_3, DispatchPattern=[True, False])  # -> ListA, ListB
flip = FlipMatrix(Data=dispatch_6.ListA)
flip_2 = FlipMatrix(Data=dispatch_6.ListB)
number_slider_2 = Slider(100, range=0..100)
item = ListItem(List=flip, Index=0, Wrap=True)
number_slider_3 = Slider(100, range=0..100)
ma = MassAddition(Input=flip_2)  # -> Result, PartialResults
flatten = FlattenTree(Tree=item, Path="{0}")
pt_6 = Point(flatten)
flatten_2 = FlattenTree(Tree=ma.Result, Path="{0}")
partition = PartitionList(List=pt_6, Size=number_slider_2)  # -> simplify(Chunks)
pdecon_3 = Deconstruct(Point=flatten)  # -> XComponent, YComponent, ZComponent
ma_2 = MassAddition(Input=flatten_2)  # -> Result, PartialResults
partition_2 = PartitionList(List=flatten_2, Size=number_slider_2)  # -> simplify(Chunks)
vec_3 = VectorXYZ(XComponent=pdecon_3.XComponent, YComponent=pdecon_3.YComponent, ZComponent=pdecon_3.ZComponent)  # -> Vector, Length
panel_4 = Panel(ma_2.Result)
division = Division(A=Slider(10, range=0..10), B=Slider(2, range=0..10))
bnd = Bounds(Numbers=flatten_2)
remap = RemapNumbers(Value=flatten_2, Source=bnd, Target=Domain(0, 1))  # -> Mapped, Clipped
dom = ConstructDomain(DomainStart=expr("-x", division), DomainEnd=division)
rectangle_2 = Rectangle(Plane=vec_3.Vector, XSize=dom, YSize=dom, Radius=0)  # -> Rectangle, Length
xyz = ColourXYZ(Alpha=1, X=remap.Mapped, Y=remap.Mapped, Z=remap.Mapped)
c_script_5 = CSharpScript(P=partition, Cell=Slider(10, range=0..10))  # -> Info, M; inputs P: tree of Point3d, Cell: Double
# ---------- c_script_5: C# ----------
// Grasshopper Script Instance
#region Usings
using System;
using System.Collections.Generic;
using Rhino;
using Rhino.Geometry;

using Grasshopper;
using Grasshopper.Kernel;
using Grasshopper.Kernel.Data;
using Grasshopper.Kernel.Types;
#endregion

public class Script_Instance : GH_ScriptInstance
{
  private void RunScript(DataTree<Point3d> P, double Cell, ref object M)
  {
    if (P == null || P.BranchCount == 0) { M = null; return; }
    if (Cell <= 0) { M = null; return; }

    double h = Cell * 0.5;
    var tree = new GH_Structure<GH_Mesh>();
    var path = new GH_Path(0);

    for (int b = 0; b < P.BranchCount; b++)
    {
      IList<Point3d> pts = P.Branch(b);
      for (int i = 0; i < pts.Count; i++)
      {
        Point3d c = pts[i];
        Mesh m = new Mesh();
        m.Vertices.Add(c.X - h, c.Y - h, c.Z);
        m.Vertices.Add(c.X + h, c.Y - h, c.Z);
        m.Vertices.Add(c.X + h, c.Y + h, c.Z);
        m.Vertices.Add(c.X - h, c.Y + h, c.Z);
        m.Faces.AddFace(0, 1, 2, 3);
        m.Normals.ComputeNormals();
        tree.Append(new GH_Mesh(m), path);
      }
    }

    M = tree;
  }
}
# ---------- end c_script_5 ----------
mesh = Mesh(c_script_5.M)
preview = CustomPreview(Geometry=mesh, Material=xyz)

# ---- group: 生成阴影网格
file_4 = ReadFile(File=c_script_4, PerLineParse=True)  # -> simplify(Content)
dispatch_7 = Dispatch(List=file_4, DispatchPattern=[True, False])  # -> ListA, ListB
division_2 = Division(A=Slider(10, range=0..10), B=Slider(2, range=0..10))
dom_2 = ConstructDomain(DomainStart=expr("-x", division_2), DomainEnd=division_2)

# ----
flip_3 = FlipMatrix(Data=dispatch_7.ListA)
flip_4 = FlipMatrix(Data=dispatch_7.ListB)
item_2 = ListItem(List=flip_3, Index=0, Wrap=True)
ma_3 = MassAddition(Input=flip_4)  # -> Result, PartialResults
flatten_3 = FlattenTree(Tree=item_2, Path="{0}")
pt_7 = Point(flatten_3)
flatten_4 = FlattenTree(Tree=ma_3.Result, Path="{0}")
partition_3 = PartitionList(List=pt_7, Size=number_slider_3)  # -> simplify(Chunks)
ma_4 = MassAddition(Input=flatten_4)  # -> Result, PartialResults
partition_4 = PartitionList(List=flatten_4, Size=number_slider_3)  # -> simplify(Chunks)
panel_5 = Panel(ma_4.Result)
c_script_6 = CSharpScript(P=partition_3, Cell=Slider(10, range=0..10))  # -> Info, M; inputs P: tree of Point3d, Cell: Double; same code as c_script_5
mesh_2 = Mesh(c_script_6.M)

# ---- group: 生成阴影网格 (continued)
pdecon_4 = Deconstruct(Point=flatten_3)  # -> XComponent, YComponent, ZComponent
vec_4 = VectorXYZ(XComponent=pdecon_4.XComponent, YComponent=pdecon_4.YComponent, ZComponent=pdecon_4.ZComponent)  # -> Vector, Length
bnd_2 = Bounds(Numbers=flatten_4)
remap_2 = RemapNumbers(Value=flatten_4, Source=bnd_2, Target=Domain(0, 1))  # -> Mapped, Clipped
rectangle_3 = Rectangle(Plane=vec_4.Vector, XSize=dom_2, YSize=dom_2, Radius=0)  # -> Rectangle, Length
xyz_2 = ColourXYZ(Alpha=1, X=remap_2.Mapped, Y=remap_2.Mapped, Z=remap_2.Mapped)
preview_2 = CustomPreview(Geometry=mesh_2, Material=xyz_2)
