# Grasshopper definition comparison.gh (Grasshopper 1.0.8)
# plug-ins: Wallacei

number_slider = Slider(9, range=2..10)
extrude = GenePool(Decimals=2, Maximum=100, Minimum=0, Value=[61.22, 18.97, 18.5, 98.79, 66.07, 20.7, 50.3, 31.99, 30.47, 50.29])
genes = GenePool(Decimals=2, Maximum=1, Minimum=-1, Value=[0.65, -0.55, -0.67, -0.56, 0.97, -0.55, 0.27, 0.36, 0.62, 0.33])
number_slider_2 = Slider(1000, range=0..1000)
integer_division = IntegerDivision(A=Slider(1000, range=0..1000), B=number_slider)
series = Series(Start=0, Step=integer_division, Count=expr("x+1", number_slider))
pt = ConstructPoint(XCoordinate=0, YCoordinate=0, ZCoordinate=0)
X = UnitX(Factor=1)
rectangle = Rectangle(Plane=PlaneXY(0, 0, 0), XSize=number_slider_2, YSize=number_slider_2, Radius=0)  # -> Rectangle, Length
Z = UnitZ(Factor=series)
split = SplitList(List=extrude, Index=expr("x+1", number_slider))  # -> ListA, ListB
split_2 = SplitList(List=genes, Index=expr("x+1", number_slider))  # -> ListA, ListB
line = LineSDL(Start=pt, Direction=X, Length=number_slider_2)
pi = Pi(Factor="0.3333")
boundary = BoundarySurfaces(Edges=rectangle.Rectangle)
move = Move(Geometry=line, Motion=Z)  # -> Geometry, Transform
Y = UnitY(Factor=split.ListA)
multiplication = Multiplication(A=split_2.ListA, B=pi)
move_2 = Move(Geometry=move.Geometry, Motion=expr("-x", Y))  # -> Geometry, Transform
rotax = RotateAxis(Geometry=move_2.Geometry, Angle=multiplication, Axis=move.Geometry)  # -> Geometry, Transform
rulesrf = RuledSurface(CurveA=move.Geometry, CurveB=rotax.Geometry)
panel = Panel("D:\00Study\CHN_JS_Nanjing.582380_TMYx.2004-2018\CHN_JS_Nanjing.582380_TMYx.2004-2018.epw")
epwmap = LBEPWmap(epw_map=Toggle(False))  # -> report; plug-in component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
count = Integer("7")
start = Integer("9")
step = Integer("1")
importloc = LBImportLocation(epw_file=panel)  # -> location; plug-in component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
series_2 = Series(Start=start, Step=step, Count=count)
series_3 = Series(Start=start, Step=step, Count=count)
series_4 = Series(Start=start, Step=step, Count=count)
series_5 = Series(Start=start, Step=step, Count=count)
analysisperiod = LBAnalysisPeriod(start_month="6", start_day="21", start_hour=series_2, end_month="6", end_day="21", end_hour=series_3)  # -> period, hoys, dates; plug-in component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
analysisperiod_2 = LBAnalysisPeriod(start_month="12", start_day="21", start_hour=series_4, end_month="12", end_day="21", end_hour=series_5)  # -> period, hoys, dates; plug-in component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
number_slider_3 = Slider(0, range=0..1000)
number_slider_4 = Slider(0.02, range=0..1)
sunpath = LBSunPath(north=number_slider_3, location=importloc, hoys=analysisperiod.hoys, scale=number_slider_4)  # -> report, vectors, altitudes, azimuths, hoys, sun_pts, analemma, daily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; plug-in component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
sunpath_2 = LBSunPath(north=number_slider_3, location=importloc, hoys=analysisperiod_2.hoys, scale=number_slider_4)  # -> report, vectors, altitudes, azimuths, hoys, sun_pts, analemma, daily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; plug-in component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
lng = ListLength(List=sunpath.vectors)  # -> flatten(Length)
addition = Addition(A=lng, B=1)
colrange = LBColorRange(index="5")  # -> colors; plug-in component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
panel_2 = Panel("0")
item = ListItem(List=addition, Index=0, Wrap=True)
legendpar = LBLegendParameters(seg_count=item, colors=flatten(colrange))  # -> leg_par; plug-in component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
rectangle_2 = Rectangle(Plane=PlaneXY(0, 0, 0), XSize=Slider(4000, range=0..10000), YSize=Slider(2000, range=0..10000), Radius=0)  # -> Rectangle, Length
rotax_2 = RotateAxis(Geometry=rectangle_2.Rectangle, Angle=3.141592654, Axis=Line((0, 0, 0), (10, 0, 0)))  # -> Geometry, Transform
Z_2 = UnitZ(Factor=Slider(2000, range=0..10000))
boundary_2 = BoundarySurfaces(Edges=rectangle_2.Rectangle)
number_slider_5 = Slider(8, range=0..10)
boundary_3 = BoundarySurfaces(Edges=rotax_2.Geometry)
toggle = BooleanToggle(True)
shading_component = Brep(rulesrf)
flip = Flip(Surface=boundary_3)  # -> Surface, Result
geometry = Geometry(boundary)
directsunhours = LBDirectSunHours(
    vectors=flatten(sunpath.vectors),
    timestep="1",
    geometry=flatten(geometry),
    context=flatten(shading_component),
    grid_size="10",
    offset_dist="0.01",
    legend_par=flatten(legendpar),
    cpu_count=number_slider_5,
    run=toggle)  # -> report, points, simplify(results), mesh, legend, title, int_mtx; plug-in component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
directsunhours_2 = LBDirectSunHours(
    vectors=flatten(sunpath_2.vectors),
    geometry=flatten(geometry),
    context=flatten(shading_component),
    grid_size="10",
    offset_dist="0.01",
    legend_par=legendpar,
    cpu_count=number_slider_5,
    run=toggle)  # -> report, points, results, mesh, legend, title, int_mtx; plug-in component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
division = Division(A=Slider(4000, range=0..10000), B="10")
division_2 = Division(A=Slider(2000, range=0..10000), B="10")
larger = LargerThan(FirstNumber=flatten(directsunhours_2.results), SecondNumber="0")  # -> LargerThan, OrEqualTo
mjoin = MeshJoin(Meshes=directsunhours_2.mesh)
multiplication_2 = Multiplication(A=division, B=division_2)
X_2 = UnitX(Factor=expr("-x", Slider(1200, range=0..10000)))
flatten = FlattenTree(Tree=directsunhours.results, Path="{0}")
flatten_2 = FlattenTree(Tree=directsunhours_2.results, Path="{0}")
number_slider_6 = Slider(0.333, range=0..1)
cullf = CullFaces(Mesh=mjoin, Pattern=larger.LargerThan)
move_3 = Move(Geometry=directsunhours_2.mesh, Motion=X_2)  # -> Geometry, Transform
ma = MassAddition(Input=flatten_2)  # -> Result, PartialResults
ma_2 = MassAddition(Input=flatten)  # -> Result, PartialResults
area = Area(Geometry=flatten(cullf))  # -> Area, Centroid
multiplication_3 = Multiplication(A=area.Area, B=number_slider_6)
multiplication_4 = Multiplication(A=ma_2.Result, B=Slider(1, range=0..1))
multiplication_5 = Multiplication(A=ma.Result, B=number_slider_6)
subtraction = Subtraction(A=multiplication_5, B=multiplication_4)
neg = Negative(Value=ma.Result)
panel_3 = Panel("""旋转角度+-5°
长度是间距的1.2倍
也是周期性""")
wlc_summer = Integer(ma_2.Result)
wlc_winter = Integer(neg)
panel_4 = Panel(ma.Result)
panel_5 = Panel(ma_2.Result)
wallacei_x = WallaceiX(
    Genes=[genes, extrude, number_slider],
    Objectives=[wlc_summer, wlc_winter],
    allFitness="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",
    allFrontIdx="76|38;84|23;87|29;88|32;89|9;89|16;89|21;90|4;91|4;91|19;92|7;92|9;93|6;93|28;93|33;93|35;94|29;94|30;94|34;94|36;95|38;96|41;96|42;96|44;97|11;97|30;98|31;98|32;98|33;98|34;98|35;98|36;98|37;98|38;99|32;99|33;99|34;99|35;99|36;99|37;99|38;99|39;99|40;99|41;99|42",
    allGenomes="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",
    curFrontIdx="99|0;99|1;99|2;99|3;99|4;99|5;99|6;99|7;99|8;99|9;99|10;99|11;99|12;99|13;99|14;99|15;99|16;99|17;99|18;99|19;99|20;99|21;99|22;99|23;99|24;99|25;99|26;99|27;99|28;99|29;99|30;99|31;99|32;99|33;99|34;99|35;99|36;99|37;99|38;99|39;99|40;99|41;99|42",
    curFrontIdxSave="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",
    popGen="50,100",
    total="4105125",
    wlcDone=True)  # -> WallaceiGenomes, FitnessValues, Data, WPhenotypes
panel_6 = Panel("""打印
1：1
1m*1m""")

# ---- group: 光照模拟差异对比
panel_7 = Panel("42538")
panel_8 = Panel("47589")
panel_9 = Panel("41868")
panel_10 = Panel("47373")
